vi "index.gviweb"   [G Web Development Software 22.3.0]
panel controls:
  "stop": bool
  "Fd": f64 = 5
  "Fc": f64 = 5
  "forstyrrelse Fd": bool = TRUE
  "Pause": bool
  "P-REGULATOR": bool
  "SKAL-verdi": f64 = 50
  "Kp": f64 = 0.5
panel indicators:
  "Trendkurver for nivå": cluster{"Element 1": f64, "Element 2": f64}
  "Tank": f64
  "Fut": f64
  "Trendkurver for prosesstrømmer": T1
  "Er verdi": f64
  "F_c": f64
  "F_d": f64
  "Poeng:": i32
  "Reguleringsavvik": f64
  "absolute value": f64
types:
  T1 = cluster{"Element 1": f64, "Element 2": f64, "Element 3": f64}
diagram:
  s1 = 50  # shift register
  s2 = 0  # shift register
  s3 = 0  # shift register
  while {
    Build Cluster(s1, $"SKAL-verdi") -> w1
    $"Trendkurver for nivå" <- w1
    $Tank <- s1
    $F_d <- $Fd
    Subtract(x=$"SKAL-verdi", y=$"Er verdi") -> w2
    $Reguleringsavvik <- w2
    In Range And Coerce(lower limit=0, upper limit=10, x=$Fc) -> (coerced(x)=w3)
    Build Cluster($Fd, w3, $Fut) -> w4
    $"Trendkurver for prosesstrømmer" <- w4
    $F_c <- w3
    Add($Fd, w3) -> w5
    Subtract(x=w5, y=$Fut) -> w6
    Add(w6, s1) -> w7
    In Range And Coerce(lower limit=0, upper limit=100, x=w7) -> (coerced(x)=w8)
    $"Er verdi" <- w8
    Square Root(x=s1) -> w9
    Square Root(x=2) -> w10
    Multiply(w9, w10) -> w11
    $Fut <- w11
    case ($"forstyrrelse Fd") {
      frame False, Default {
        w12 = 0
      }
      frame True {
        Increment(x=s2) -> w13
        Is Greater(x=w13, y=40) -> w14
        Select(s=w14, t=0, f=w13) -> w12
        Is Less(x=s2, y=1) -> w15
        case (w15) {
          frame False, Default { }
          frame True {
            Random Number() -> (number (0 to 1)=w16)
            Multiply(w16, 10) -> w17
            $Fd <- w17
          }
        }
      }
    }
    case ($Pause) {
      frame False, Default { }
      frame True {
        while {
          Not(x=$Pause) -> w18
          stop if w18
        }
      }
    }
    case ($"P-REGULATOR") {
      frame False, Default { }
      frame True {
        Subtract(x=$"SKAL-verdi", y=$"Er verdi") -> w19
        Multiply(w19, $Kp) -> w20
        $Fc <- w20
      }
    }
    Absolute Value(x=$Reguleringsavvik) -> w21
    $"absolute value" <- w21
    Add(s3, 1) -> w22
    Is Greater(x=w21, y=30) -> w23
    case (w23) {
      frame False, Default {
        w24 = w22
      }
      frame True {
        Subtract(x=w22, y=5) -> w24
      }
    }
    Wait(time to wait=250)
    $"Poeng:" <- s3
    next s1 = w8
    next s2 = w12
    next s3 = w24
    stop if $stop
  }
